# Grasshopper definition script.gh (Grasshopper 1.0.7)
# plug-ins: Pancake, LunchBox, Pufferfish, Wombat

analysis_max = GetInteger(
    Slider(1200, range=0..10000),
    AtLeast=1,
    AtMost=1,
    Maximum=2147483647,
    Minimum=-2147483648,
    Prompt="start_month",
    TreeAccess=False)
analysis_min = GetInteger(
    Slider(0, range=0..500),
    AtLeast=1,
    AtMost=1,
    Maximum=2147483647,
    Minimum=-2147483648,
    Prompt="start_month",
    TreeAccess=False)
color_index = GetInteger(
    Slider(1, range=0..26),
    AtLeast=1,
    AtMost=1,
    Maximum=2147483647,
    Minimum=-2147483648,
    Prompt="start_month",
    TreeAccess=False)

end_day = GetInteger(
    Slider(31, range=1..31),
    AtLeast=1,
    AtMost=1,
    Maximum=2147483647,
    Minimum=-2147483648,
    Prompt="start_month",
    TreeAccess=False)
start_month = GetInteger(
    Slider(1, range=1..12),
    AtLeast=1,
    AtMost=1,
    Maximum=2147483647,
    Minimum=-2147483648,
    Prompt="start_month",
    TreeAccess=False)
start_day = GetInteger(
    Slider(1, range=1..31),
    AtLeast=1,
    AtMost=1,
    Maximum=2147483647,
    Minimum=-2147483648,
    Prompt="start_day",
    TreeAccess=False)
start_hour = GetInteger(
    Slider(6, range=1..24),
    AtLeast=1,
    AtMost=1,
    Maximum=2147483647,
    Minimum=-2147483648,
    Prompt="start_month",
    TreeAccess=False)
end_month = GetInteger(
    Slider(12, range=1..12),
    AtLeast=1,
    AtMost=1,
    Maximum=2147483647,
    Minimum=-2147483648,
    Prompt="start_month",
    TreeAccess=False)
end_hour = GetInteger(
    Slider(20, range=1..24),
    AtLeast=1,
    AtMost=1,
    Maximum=2147483647,
    Minimum=-2147483648,
    Prompt="start_month",
    TreeAccess=False)
timestep = GetInteger(
    Slider(1, range=0..100),
    AtLeast=1,
    AtMost=1,
    Maximum=2147483647,
    Minimum=-2147483648,
    Prompt="start_month",
    TreeAccess=False)

path = FilePath("C:\skp\tut-app\files\context1.obj")
path_2 = FilePath("C:\skp\tut-app\files\Building03.obj")
epw_loc = GetString("대전", AtLeast=1, AtMost=1, TreeAccess=False)
filepath = GetFilePath(path_2, AtLeast=1, AtMost=1, TreeAccess=False)
contextpath = GetFilePath(path, AtLeast=1, AtMost=1, TreeAccess=False)
python = GhPythonScript(city_name=epw_loc)  # -> out, link
# ---------- python: Python ----------
import rhinoscriptsyntax as rs

print(city_name)
# 지명과 링크를 매핑한 딕셔너리
weather_data_links_by_city = {
    '서울': "https://climate.onebuilding.org/WMO_Region_2_Asia/KOR_South_Korea/SO_Seoul/KOR_SO_Natl.Museum.of.Korea.471105_TMYx.zip",
    '인천': "https://energyplus-weather.s3.amazonaws.com/asia_wmo_region_2/KOR/KOR_Inchon.471120_IWEC/KOR_Inchon.471120_IWEC.zip",
    '강릉': "https://energyplus-weather.s3.amazonaws.com/asia_wmo_region_2/KOR/KOR_Kangnung.471050_IWEC/KOR_Kangnung.471050_IWEC.zip",
    '울산': "https://energyplus-weather.s3.amazonaws.com/asia_wmo_region_2/KOR/KOR_Ulsan.471520_IWEC/KOR_Ulsan.471520_IWEC.zip",
    '광주': "https://energyplus-weather.s3.amazonaws.com/asia_wmo_region_2/KOR/KOR_Kwangju.471560_IWEC/KOR_Kwangju.471560_IWEC.zip",
    '제주': "https://climate.onebuilding.org/WMO_Region_2_Asia/KOR_South_Korea/CJ_Jeju-do/KOR_CJ_Jeju.471840_TRY_PHIKO.zip",
    '서귀포': "https://climate.onebuilding.org/WMO_Region_2_Asia/KOR_South_Korea/CJ_Jeju-do/KOR_CJ_Seogwipo.471890_TMYx.zip",
    '대전': "https://climate.onebuilding.org/WMO_Region_2_Asia/KOR_South_Korea/TJ_Daejeon/KOR_TJ_Daejeon.471330_TRY_PHIKO.zip",
    '보령': "https://climate.onebuilding.org/WMO_Region_2_Asia/KOR_South_Korea/HN_Chungcheongnam-do/KOR_HN_Boryeong.471500_TMYx.zip",
    '울진': "https://climate.onebuilding.org/WMO_Region_2_Asia/KOR_South_Korea/KB_Gyeongsangbuk-do/KOR_KB_Uljin.WS.471300_TMYx.zip",
    '대구': "https://climate.onebuilding.org/WMO_Region_2_Asia/KOR_South_Korea/TG_Daegu/KOR_TG_Daegu.471430_TRY_PHIKO.zip",
    '창원': "https://climate.onebuilding.org/WMO_Region_2_Asia/KOR_South_Korea/KN_Gyeongsangnam-do/KOR_KN_Changwon.471550_TMYx.zip",
    '부산': "https://climate.onebuilding.org/WMO_Region_2_Asia/KOR_South_Korea/PU_Busan/KOR_PU_Busan.471590_TRY_PHIKO.zip",
    '춘천': "https://climate.onebuilding.org/WMO_Region_2_Asia/KOR_South_Korea/KW_Gangwon-do/KOR_KW_Chuncheon.471010_TRY_PHIKO.zip",
    '원주': "https://climate.onebuilding.org/WMO_Region_2_Asia/KOR_South_Korea/KW_Gangwon-do/KOR_KW_Wonju.471140_TRY_PHIKO.zip",
    '전주': "https://climate.onebuilding.org/WMO_Region_2_Asia/KOR_South_Korea/CB_Jeollabuk-do/KOR_CB_Jeonju.471460_TRY_PHIKO.zip",
    '청주': "https://climate.onebuilding.org/WMO_Region_2_Asia/KOR_South_Korea/HB_Chungcheongbuk-do/KOR_HB_Cheongju.471310_TRY_PHIKO.zip",
    '목포': "https://climate.onebuilding.org/WMO_Region_2_Asia/KOR_South_Korea/CN_Jeollanam-do/KOR_CN_Mokpo.471650_TRY_PHIKO.zip"
}

# 링크 찾기
link = weather_data_links_by_city.get(city_name, "해당 지명의 링크를 찾을 수 없습니다.")
# ---------- end python ----------
위치 = ContextPrint(Text=flatten(epw_loc))
pcimportobj = ImportOBJ(File=filepath, MapYtoZ=Toggle(True), LastSaveLocalization="neutral,N")  # -> flatten(Geo)
pcimportobj_2 = ImportOBJ(File=contextpath, MapYtoZ=Toggle(True), LastSaveLocalization="neutral,N")  # -> flatten(Geo)

# ---- group: Website에서 기상파일 가져오기
downloadepw = LBDownloadWeather(weather_URL=python.link)  # -> epw_file, stat_file, ddy_file; plug-in component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

# ----
colrange = LBColorRange(index=color_index)  # -> colors; plug-in component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

# ----
# reduce to 10000
mjoin = MeshJoin(Meshes=pcimportobj)
mshreduce = MeshReduce(Mesh=mjoin, TargetSize="10000", Distort=Toggle(True), Accuracy="10", NormalizeSize=False)

concat = Concatenate(
    FragmentA=start_month,
    FragmentB="월",
    FragmentC=start_day,
    FragmentD="일",
    FragmentE=start_hour,
    FragmentF="시 ~ ",
    FragmentH=end_month,
    FragmentI="월",
    FragmentJ=end_day,
    FragmentK="일",
    FragmentL=end_hour,
    FragmentM="시 까지")
concat_2 = Concatenate(FragmentN=" (1시간을", FragmentO=timestep, FragmentP="스텝으로 나누어 계산)")
panel = Panel(concat_2)
context_print = ContextPrint(Text=concat)
panel_2 = Panel(concat)
context_print_2 = ContextPrint(Text=concat_2)

importepw = LBImportEPW(epw_file=downloadepw.epw_file)  # -> location, dry_bulb_temperature, dew_point_temperature, relative_humidity, wind_speed, wind_direction, direct_normal_rad, diffuse_horizontal_rad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; plug-in component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
context_bake = ContextBake(ContextGeometry=pcimportobj_2)
number_slider = Slider(0, range=0..360)
legendpar = LBLegendParameters(min=analysis_min, max=analysis_max, colors=colrange)  # -> leg_par; plug-in component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
analysisperiod = LBAnalysisPeriod(
    start_month=start_month,
    start_day=start_day,
    start_hour=start_hour,
    end_month=end_month,
    end_day=end_day,
    end_hour=end_hour,
    timestep=timestep)  # -> period, hoys, dates; plug-in component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
skymatrix = LBCumulativeSkyMatrix(
    north=number_slider,
    location=importepw.location,
    direct_rad=importepw.direct_normal_rad,
    diffuse_rad=importepw.diffuse_horizontal_rad,
    hoys=analysisperiod.hoys,
    high_density=Toggle(False))  # -> report, sky_mtx; plug-in component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
sunpath = LBSunPath(north=number_slider, location=importepw.location, solar_time=Toggle(True), scale=Slider(0.001, range=0..0.001))  # -> report, vectors, altitudes, azimuths, hoys, sun_pts, analemma, daily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; plug-in component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

panel_3 = Panel("""4
5
6
11
12
13
14
15
16
17
18
19
20
21
22""")
item = ListItem(List=sunpath.compass, Index=panel_3, Wrap=True)
panel_4 = Panel("""7
8
9
10""")
item_2 = ListItem(List=sunpath.compass, Index=panel_4, Wrap=True)
bool = Boolean(True)
crv = Curve([sunpath.daily, sunpath.analemma])
geo = Geometry(item)
multiplication = Multiplication(A="1000", B=1000)
crv_2 = Curve()
run_solar_analysis = GetBoolean(bool, AtLeast=1, AtMost=1, FalseValue="False", TreeAccess=False, TrueValue="True")
grid_size = GetBoolean(multiplication, AtLeast=1, AtMost=1, FalseValue="False", TreeAccess=False, TrueValue="True")
offset_dist = GetBoolean("1", AtLeast=1, AtMost=1, FalseValue="False", TreeAccess=False, TrueValue="True")
area = Area(Geometry=mshreduce)  # -> Area, Centroid
incidentradiation = LBIncidentRadiation(
    sky_mtx=skymatrix.sky_mtx,
    geometry=flatten(mshreduce),
    context=flatten(pcimportobj_2),
    grid_size=grid_size,
    offset_dist=offset_dist,
    legend_par=legendpar,
    run=run_solar_analysis)  # -> report, points, results, total, mesh, legend, title, int_mtx; plug-in component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
ma = MassAddition(Input=area.Area)  # -> Result, PartialResults
division = Division(A=ma.Result, B="1000")
list_item = ListItem(List=incidentradiation.legend, Index=0, Wrap=True)
avr = Average(Input=incidentradiation.results)
mesh = Mesh(list_item)
mesh_2 = Mesh(incidentradiation.mesh)
demesh = DeconstructMesh(Mesh=list_item)  # -> Vertices, Faces, Colours, Normals
medges = MeshEdges(Mesh=list_item)  # -> NakedEdges, InteriorEdges, NonManifoldEdges
medges_2 = MeshEdges(Mesh=mesh_2)  # -> NakedEdges, InteriorEdges, NonManifoldEdges
deface = DeconstructFace(Face=demesh.Faces)  # -> CornerA, CornerB, CornerC, CornerD
split = SplitList(List=incidentradiation.legend, Index="2")  # -> ListA, ListB
crv_3 = Curve([medges_2.NonManifoldEdges, medges_2.InteriorEdges])
merge = Merge(Data1=geo, Data2=crv_3, Data3=crv)  # -> flatten(Result)
curves = ContextBake(Geometry=flatten(merge))
crv_4 = Curve([medges.NakedEdges, medges.InteriorEdges])
mesh_join = MeshJoin(Meshes=flatten([mesh_2, mesh]))
item_3 = ListItem(List=demesh.Vertices, Index=deface.CornerC, Wrap=True)
python_2 = GhPythonScript(x=split.ListB)  # -> out, a; inputs x: list
# ---------- python_2: Python ----------
# 입력된 텍스트가 리스트 형태인 경우
input_texts = x  # 이제 x는 리스트입니다.

# 각 텍스트 항목에 대해 뒤에서 3자리를 제외하고 "Kwh"를 추가
output_texts = [text[:-3] + " KWh/m2" for text in input_texts]

# 결과 출력
a = output_texts
# ---------- end python_2 ----------
context_bake_2 = ContextBake(Geometry=flatten(mesh_join))
python_3 = GhPythonScript(text=graft(python_2.a), textpt=graft(item_3))  # -> flatten(mesh); inputs text: list, textpt: Point3d; disabled
# ---------- python_3: Python ----------
import Rhino as rc
import System

def textJustificationEnumeration(justificationIndex):
        #justificationIndices:
        # 0 - bottom left (default)
        # 1 - bottom center
        # 2 - bottom right
        # 3 - middle left
        # 4 - center
        # 5 - middle right
        # 6 - top left
        # 7 - top middle
        # 8 - top right
        constantsList  = [0, 2, 4, 131072, 131074, 131076, 262144, 262146, 262148]
        try:
            justificationConstant = constantsList[justificationIndex]
        except:
            # if 0 < justificationIndex > 8
            justificationConstant = 0
        textJustification = System.Enum.ToObject(rc.Geometry.TextJustification, justificationConstant)
        return textJustification


def text2srf(text, textPt, font = 'Verdana', textHeight = 20, bold = False, plane = None, justificationIndex = 0):
        # Thanks to Giulio Piacentino for his version of text to curve
        textSrfs = []
        textJustification = textJustificationEnumeration(justificationIndex)
        textJustification = 0
        planeCheck = False
        
        scale = rc.RhinoDoc.ActiveDoc.DimStyles.CurrentDimensionStyle.DimensionScale
        
        for n in range(len(text)):
            textobject = text[n].ToString()
            print textobject
            
            if plane == None or planeCheck == True:
                plane = rc.Geometry.Plane(textPt, rc.Geometry.Vector3d(0,0,1))
                planeCheck = True
            if type(textobject) is not str:
                preText = rc.RhinoDoc.ActiveDoc.Objects.AddText(`textobject`, plane, textHeight, font, bold, False, textJustification)
            else:
                preText = rc.RhinoDoc.ActiveDoc.Objects.AddText( textobject, plane, textHeight, font, bold, False, textJustification)
            
            postText = rc.RhinoDoc.ActiveDoc.Objects.Find(preText)
            TG = postText.Geometry
            crvs = TG.Explode()
            
            # join the curves
            joindCrvs = rc.Geometry.Curve.JoinCurves(crvs)
            
            # create the surface
            srfs = rc.Geometry.Brep.CreatePlanarBreps(joindCrvs)
            
            
            extraSrfCount = 0
            # = generate 2 surfaces
            if "=" in textobject: extraSrfCount += -1
            if ":" in textobject: extraSrfCount += -1
            
            if srfs:
                if len(textobject.strip()) != len(srfs) + extraSrfCount:
                    # project the curves to the place in case number of surfaces
                    # doesn't match the text
                    projectedCrvs = []
                    for crv in joindCrvs:
                        projectedCrvs.append(rc.Geometry.Curve.ProjectToPlane(crv, plane))
                    srfs = rc.Geometry.Brep.CreatePlanarBreps(projectedCrvs)
                
                #Mesh the surfcaes.
                meshSrfs = []
                for srf in srfs:
                    srf.Flip()
                    try:
                        meshSrf = rc.Geometry.Mesh.CreateFromBrep(srf, rc.Geometry.MeshingParameters.Coarse)[0]
                    except TypeError:
                        # pass very small surfaces
                        continue
                    else:
                        meshSrf.VertexColors.CreateMonotoneMesh(System.Drawing.Color.Black)
                        meshSrfs.append(meshSrf)
                
                textSrfs.extend(meshSrfs)
            
            rc.RhinoDoc.ActiveDoc.Objects.Delete(postText, True) # find and delete the text
        
        return textSrfs

mesh = text2srf(text, textpt, font = 'Verdana', textHeight = 0.8, bold = False, plane = None, justificationIndex = 0)
# ---------- end python_3 ----------
mshnakededgs = MeshNakedEdges(Mesh=python_3)  # -> Naked, R; disabled
join = JoinCurves(Curves=mshnakededgs.Naked, Preserve=False)  # -> flatten(Curves); disabled
boundarym = BoundaryMesh(Polyline=join)  # disabled

# ---- group: Bake colored OBJ (color vertices)
save_path = GetFilePath("C:\skp\viktor-apps\tut_viktor\files\", AtLeast=1, AtMost=1, TreeAccess=False)
path_3 = FilePath(save_path)
c_script = CSharpScript(in_run=Toggle(True), in_mesh=mesh_2, in_name="ColoredOBJ", in_path=path_3)  # -> out, A; inputs in_run: Boolean, in_mesh: list of Mesh, in_name: String, in_path: String
# ---------- c_script: C# usings ----------
using System.IO;
using System.Linq;
using System.Data;
using System.Drawing;
using System.Reflection;
using System.Windows.Forms;
using System.Xml;
using System.Xml.Linq;
using System.Runtime.InteropServices;


using Rhino.DocObjects;
using Rhino.Collections;
using GH_IO;
using GH_IO.Serialization;
# ---------- c_script: C# ----------
    if (in_run)
    {
      try
      {
        string directory = Path.GetDirectoryName(in_path);
        string objFilename = in_name + ".obj";
        string objPath = Path.Combine(directory, objFilename);

        using (StreamWriter objWriter = new StreamWriter(objPath))
        {
          for (int meshIndex = 0; meshIndex < in_mesh.Count; meshIndex++)
          {
            Mesh mesh = in_mesh[meshIndex];
            mesh.Faces.ConvertQuadsToTriangles();

            objWriter.WriteLine("g " + in_name + "_" + meshIndex);

            // Check if the mesh has vertex colors
            bool hasVertexColors = mesh.VertexColors.Count == mesh.Vertices.Count;

            // Write vertices with colors
            for (int i = 0; i < mesh.Vertices.Count; i++)
            {
              Point3d vert = mesh.Vertices[i];
              Color vertexColor = hasVertexColors ? mesh.VertexColors[i] : Color.White;

              // Writing RGB color values as integers (0 to 255)
              objWriter.WriteLine(String.Format("v {0} {1} {2} {3} {4} {5}",
                vert.X, vert.Y, vert.Z,
                vertexColor.R, vertexColor.G, vertexColor.B));
            }

            // Write faces
            foreach (MeshFace face in mesh.Faces)
            {
              string faceIndices = String.Format("f {0} {1} {2}",
                face.A + 1, face.B + 1, face.C + 1); // OBJ index starts at 1
              objWriter.WriteLine(faceIndices);
            }
          }
        }

        A = objPath; // Output the path of the created OBJ file
      }
      catch (Exception ex)
      {
        Print("Error: " + ex.Message);
      }
    }
# ---------- c_script: C# additional code ----------
  private int ClampColorValue(float value)
  {
    return (int) Math.Max(0, Math.Min(255, value * 255));
  }
# ---------- end c_script ----------

# ----
division_2 = Division(A=avr, B=Slider(365, range=0..1000))
multiplication_2 = Multiplication(A=division, B=avr)

panel_5 = Panel(join)  # disabled
# i : 전일사
# +1 : 직달일사
# +2 : 산란일사
context_bake_3 = ContextBake(Geometry2=flatten(join))  # disabled

# ---- group: 연간 전체 일사량
expression = Expression(x=multiplication_2, Expression="Format(\"{0:##,#.0 kWh'.year}\", x)")  # -> flatten(R)
panel_6 = Panel(expression)

# ---- group: 일평균 단위면적당 일사량
expression_2 = Expression(x=division_2, Expression="Format(\"{0:##,#.00 kWh/m2'.day}\", x)")  # -> flatten(R)
panel_7 = Panel(expression_2)

# ---- group: 연간 전체 일사량
expression_3 = Expression(x=incidentradiation.total, Expression="Format(\"{0:##,#.0 kWh'.year}\", x)")  # -> flatten(R)
panel_8 = Panel(expression_3)

# ---- group: 연간 단위면적당 일사량
expression_4 = Expression(x=avr, Expression="Format(\"{0:##,#.0 kWh/m2'.year}\", x)")  # -> flatten(R)
panel_9 = Panel(expression_4)

# ---- group: 분석 면적
expression_5 = Expression(x=ma.Result, Expression="Format(\"{0:##,#.0 m2}\", x)")  # -> flatten(R)
panel_10 = Panel(expression_5)

# ----
context_print_3 = ContextPrint(연간단위면적당일사량=panel_9)
context_print_4 = ContextPrint(일평균단위면적당일사량=panel_7)

# ---- group: 연간 전체일사량의 오차율
expression_6 = Expression(x=multiplication_2, y=incidentradiation.total, Expression="Format(\"{0:##,0.0 %}\", (x/y)-1)")
panel_11 = Panel(expression_6)

# ----
context_print_5 = ContextPrint(연간전체일사량=panel_8)
context_print_6 = ContextPrint(분석면적=panel_10)
context_print_7 = ContextPrint(연간전체일사량=panel_6)
